# Grasshopper definition 01_sketch the space.gh (Grasshopper 1.0.7)
# plug-ins: Hypar Elements for Grasshopper

curve = Curve(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)
inputs = InputsAndModelDependencies(
    SketchTheSpace=curve,
    Args="null",
    Defaults="{}",
    FunctionForDocument="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",
    InputSchema="{\"type\":\"object\",\"properties\":{\"Sketch the space \":{\"$hyparOrder\":0,\"$ref\":\"https://hypar.io/Schemas/Geometry/Polygon.json\",\"description\":\"A closed planar polygon.\"}}}",
    SchemaTypeGuides="{}")
area = Area(Geometry=inputs)  # -> Area, Centroid
surface = Surface(inputs)
outputs = OutputsAndModels(
    ModelOutputSpaceBoundary=flatten(surface),
    AreaOfSpace=area.Centroid,
    FunctionForDocument="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",
    SchemaTypeGuides="{}")
